# Grasshopper definition 805_viewer.ghx (Grasshopper 1.0.7)

# ----
# Static objects
mesh = Mesh(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)
mesh_2 = Mesh(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)

# ----
# Load robot
button = Button()
irb910sc = GhPythonScript(load=button)  # -> robot
# ---------- irb910sc: Python ----------
import os
from compas.robots import RobotModel
from compas.robots import LocalPackageMeshLoader
from compas_fab.robots import Robot
from compas_fab.robots import RobotSemantics
from compas_ghpython.artists import RobotModelArtist

HERE = os.path.dirname(ghenv.Component.OnPingDocument().FilePath)

models_path = os.path.join(HERE, '..', 'docker', 'irb910sc-planner')

urdf_file = os.path.join(models_path, 'abb_irb910sc_support', 'urdf', 'irb910sc_3_065.urdf')
srdf_file = os.path.join(models_path, 'abb_irb910sc_3_065_moveit_config', 'config', 'irb910.srdf')

model = RobotModel.from_urdf_file(urdf_file)
semantics = RobotSemantics.from_srdf_file(srdf_file, model)
loader = LocalPackageMeshLoader(models_path, 'abb_irb910sc_support')

model.load_geometry(loader)

robot = Robot(model, semantics=semantics)
robot.artist = RobotModelArtist(model)
robot.info()
# ---------- end irb910sc ----------
tool = GhPythonScript(robot=irb910sc, attach=Button(), detach=Button())  # -> robot
# ---------- tool: Python ----------
import os
from compas.datastructures import Mesh
from compas.geometry import Frame
from compas_fab.robots import Tool
from compas_ghpython.artists import RobotModelArtist

HERE = os.path.dirname(ghenv.Component.OnPingDocument().FilePath)

if robot:
    if attach:
        vmesh = Mesh.from_stl(os.path.join(HERE, 'vacuum-gripper-visual.stl'))
        cmesh = Mesh.from_stl(os.path.join(HERE, 'vacuum-gripper-collision.stl'))
        frame = Frame([0, 0, -0.04328], [1, 0, 0], [0, 1, 0])
        tool = Tool(visual=vmesh, frame_in_tool0_frame=frame, collision=cmesh)
        robot.attach_tool(tool)
    if detach:
        robot.detach_tool()
# ---------- end tool ----------

# ----
# Live update
toggle = BooleanToggle(False)
ros = ROSConnect(ip="ros-vzby-dzht.yaler.io", port=80, connect=toggle)  # -> ros_client, is_connected; inputs port: Int32, connect: Boolean
#   port ip: The ip address ROS. Defaults to 127.0.0.1.
#   port port: The port of ROS. Defaults to 9090.
#   port connect: If True, connects to ROS. If False, disconnects from ROS. Defaults to False.
#   port ros_client: The ROS client.
#   port is_connected: True if connection established.
# ---------- ros: Python ----------
"""
Connect or disconnect to ROS.

COMPAS FAB v0.18.0
"""
from ghpythonlib.componentbase import executingcomponent as component
from scriptcontext import sticky as st

from compas_fab.backends import RosClient
from compas_fab.ghpython.components import create_id


class ROSConnect(component):
    def RunScript(self, ip, port, connect):
        ros_client = None

        ip = ip or '127.0.0.1'
        port = port or 9090

        key = create_id(self, 'ros_client')
        ros_client = st.get(key, None)

        if ros_client:
            st[key].close()
        if connect:
            st[key] = RosClient(ip, port)
            st[key].run(5)

        ros_client = st.get(key, None)
        is_connected = ros_client.is_connected if ros_client else False
        return (ros_client, is_connected)
# ---------- end ros ----------
subscribe = GhPythonScript(
    ros_client=ros.ros_client,
    topic_name="/joint_states",
    topic_type="sensor_msgs/JointState",
    start=Button(),
    stop=Button())  # -> topic, last_msg, is_subscribed
# ---------- subscribe: Python ----------
import Grasshopper
from ghpythonlib.componentbase import executingcomponent as component
from scriptcontext import sticky as st
import time
from roslibpy import Topic
from compas_fab.ghpython.components import create_id
from compas_fab.backends.ros import ROSmsg
import time

class ROSTopicSubscribe(component):
    def RunScript(self, ros_client, topic_name, topic_type, interval, start, stop):
        if not topic_name:
            raise ValueError('Please specify the name of the topic')
        if not topic_type:
            raise ValueError('Please specify the type of the topic')

        self.interval = interval or 25
        self.is_updating = False
        self.is_subscribed = False
        self.msg_key = create_id(self, 'last_msg')
        key = create_id(self, 'topic')

        topic = st.get(key, None)
        last_msg = st.get(self.msg_key, None)

        if ros_client and ros_client.is_connected:
            if start:
                if topic and topic.is_subscribed:
                    topic.unsubscribe()
                    time.sleep(0.2)

                topic = Topic(ros_client, topic_name, topic_type)
                topic.subscribe(self.topic_callback)
                st[key] = topic
                time.sleep(0.2)
            if stop and topic and topic.is_subscribed:
                topic.unsubscribe()
                time.sleep(0.2)

        self.is_subscribed = topic and topic.is_subscribed

        if last_msg:
            last_msg = ROSmsg.from_msg(last_msg)

        return (topic, last_msg, self.is_subscribed)

    def topic_callback(self, msg):
        st[self.msg_key] = msg

        if self.is_subscribed:
            ghdoc = ghenv.Component.OnPingDocument()
            if not self.is_updating and ghdoc.SolutionState != Grasshopper.Kernel.GH_ProcessStep.Process:
                self.is_updating = True
                ghdoc.ScheduleSolution(
                    self.interval, Grasshopper.Kernel.GH_Document.GH_ScheduleDelegate(self.expire_callback))

    def expire_callback(self, ghdoc):
        if ghdoc.SolutionState != Grasshopper.Kernel.GH_ProcessStep.Process:
            ghenv.Component.ExpireSolution(False)
        self.is_updating = False
# ---------- end subscribe ----------
python = GhPythonScript(joint_state=subscribe.last_msg, robot=irb910sc)  # -> config
# ---------- python: Python ----------
import math
from compas.robots import Joint
from compas.robots import Configuration

config = robot.zero_configuration()

for name, position in zip(joint_state.name, joint_state.position):
    joint = robot.get_joint_by_name(name)
    for i, jname in enumerate(config.joint_names):
        if jname == joint.name:
            config.joint_values[i] = position
#    if joint.type in (Joint.CONTINUOUS, Joint.REVOLUTE):
#        position = math.radians(position)
#    if joint.type == Joint.PRISMATIC:
#        position = position / 1000
#    config[joint.name] = position

print config
# ---------- end python ----------

# ----
# Assembly
panel = Panel("assembly.json")
python_2 = GhPythonScript(filename=panel, load=Toggle(True))  # -> assembly
# ---------- python_2: Python ----------
import os
import sys

HERE = os.path.dirname(ghenv.Component.OnPingDocument().FilePath)
if HERE not in sys.path: sys.path.append(HERE)

import compas

assembly = compas.json_load(os.path.join(HERE, filename))
# ---------- end python_2 ----------
python_3 = GhPythonScript(assembly=python_2)  # -> elements, frames
# ---------- python_3: Python ----------
from compas_fab.robots import JointTrajectory
from compas_ghpython.artists import MeshArtist
#from helpers import traversal_buildup_sequence
#from helpers import traversal_breadth_first_ordering
from helpers import traversal_linearly_ordered
from compas.geometry import Rotation
from compas.geometry import Translation
from compas_ghpython.artists import FrameArtist


T = Translation.from_vector([0, 0, .02]) * Rotation.from_axis_and_angle([0, 0, 1], 3.14/2)

elements = []
frames = []

for j, n in enumerate(traversal_linearly_ordered(assembly)):
    geom = assembly.element(n).geometry_at_placement
    geom = geom.transformed(T)
    mesh = MeshArtist(geom).draw()
    elements.append(mesh)

    fa = FrameArtist(assembly.element(n).frame.transformed(T), scale=.02)
    a, b = fa.draw()
    frames.extend(a)
    frames.extend(b)
# ---------- end python_3 ----------
split = SplitList(List=python_3.elements, Index=Slider(0, range=0..100))  # -> ListA, ListB
mesh_3 = Mesh(split.ListA)

robot_visualize = RobotVisualize(robot=tool, configuration=python, show_visual=True)  # -> visual, collision, attached_meshes, frames, base_frame, ee_frame; inputs attached_collision_meshes: list, show_visual: Boolean, show_collision: Boolean, show_frames: Boolean, show_base_frame: Boolean, show_end_effector_frame: Boolean, show_acm: Boolean
#   port group: The planning group used for end-effector and base visualization.
#   port configuration: The robot's full configuration.
#   port attached_collision_meshes: A list of attached collision meshes.
#   port show_visual: Whether or not to show the robot's visual meshes.
#   port show_collision: Whether or not to show the robot's collision meshes.
#   port show_frames: Whether or not to show the robot's joint frames.
#   port show_base_frame: Whether or not to show the robot's base frame.
#   port show_end_effector_frame: Whether or not to show the robot's end-effector frame.
#   port show_acm: Whether or not to show the attached collision meshes (if any).
#   port visual: Whether or not to show the attached collision meshes (if any).
#   port collision: Whether or not to show the attached collision meshes (if any).
#   port attached_meshes: Whether or not to show the attached collision meshes (if any).
#   port frames: Whether or not to show the attached collision meshes (if any).
#   port base_frame: Whether or not to show the attached collision meshes (if any).
#   port ee_frame: Whether or not to show the attached collision meshes (if any).
# ---------- robot_visualize: Python ----------
"""
Visualizes the robot.

COMPAS FAB v0.18.0
"""
from compas.geometry import Frame
from compas.geometry import Transformation
from compas_ghpython.artists import MeshArtist
from ghpythonlib.componentbase import executingcomponent as component


class RobotVisualize(component):
    def RunScript(self, robot, group, configuration, attached_collision_meshes, show_visual, show_collision,
                  show_frames, show_base_frame, show_end_effector_frame, show_acm):

        visual = None
        collision = None
        attached_meshes = None
        frames = None
        base_frame = None
        ee_frame = None

        if robot:
            show_visual = show_visual or True
            configuration = configuration or robot.zero_configuration()

            robot.update(configuration, visual=show_visual, collision=show_collision)
            frames = robot.transformed_frames(configuration, group)

            if show_visual:
                visual = robot.artist.draw_visual()

            if show_collision:
                collision = robot.artist.draw_collision()

            if show_base_frame:
                base_frame = frames[0]

            if show_end_effector_frame:
                ee_frame = robot.forward_kinematics(configuration, group, options=dict(solver='model'))

            if not show_frames:
                frames = None

            if show_acm:
                attached_meshes = []
                for acm in attached_collision_meshes:
                    frame = robot.forward_kinematics(configuration, options=dict(solver='model', link_name=acm.link_name))
                    T = Transformation.from_frame_to_frame(Frame.worldXY(), frame)
                    mesh = acm.collision_mesh.mesh.transformed(T)
                    attached_meshes.append(MeshArtist(mesh).draw())

        return (visual, collision, attached_meshes, frames, base_frame, ee_frame)
# ---------- end robot_visualize ----------
